# Grasshopper definition api.ghx (Grasshopper 1.0.7)
# plug-ins: Hops

concat = Concatenate(FragmentC="http://mmodel.contextmachine.online:8088/", FragmentA="site/rosteh/")
hops = Hops(
    Run=Toggle(True),
    Url=concat,
    Name="polygon_coords",
    CacheResultsInMemory=False,
    CacheSolveResults=False,
    RemoteDefinitionLocation="http://mmodel.contextmachine.online:5000/GET",
    RemoteSolveVersion=(0, 1, 0),
    ShowInput_Enabled=False,
    ShowInput_Path=False,
    SynchronousSolve=True)
python = GhPythonScript(x=hops, y="polygon_coords")  # -> out, a
# ---------- python: Python ----------
__author__ = "andrewastakhov"
import json

import rhinoscriptsyntax as rs
from Rhino.Geometry import Point2d
from ghpythonlib.treehelpers import list_to_tree

def decode_pts(arr):
    for pt in arr:
        yield Point2d(*pt)


a = list_to_tree(
    list(
        decode_pts(
            json.loads(x)[y]
        )
    )
)
# ---------- end python ----------
pt = Point(python.a)
